# Grasshopper definition joint_documentation_0.gh (Grasshopper 1.0.7)
# plug-ins: ghgl

crv = Curve([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])
crv_2 = Curve([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])
c_script = CSharpScript()  # -> out, Polylines, A
# ---------- c_script: C# ----------
    string[] x = System.IO.File.ReadAllLines(@"C:\IBOIS57\_Code\Software\Python\Pybind11Example\vsstudio\Release\output.txt");
    var dt = new DataTree<Polyline>();

    int c = 0;
    Polyline pline = new Polyline();
    for(int i = 0; i < x.Length;i++){

      if(x[i] == ""){
        dt.Add(new Polyline(pline), new GH_Path(c));
        pline.Clear();
        c++;
      }else{

        string[] txt = x[i].Split(' ');
        Point3d p = new Point3d(Convert.ToDouble(txt[0]), Convert.ToDouble(txt[1]), Convert.ToDouble(txt[2]));
        pline.Add(p);

      }


    }

    Polylines = dt;
# ---------- end c_script ----------
c_script_2 = CSharpScript(rect_pair=crv)  # -> out, A, B, C; inputs rect_pair: list of Polyline
# ---------- c_script_2: C# ----------
    ////////////////////////////////////////////////////////////////////
    //Number of divisions
    //Input joint line (its lengths)
    //Input distance for division
    ////////////////////////////////////////////////////////////////////
    double joint_length = Math.Abs(500);
    double division_distance = Math.Abs(60);
    int divisions = (int) Math.Ceiling(joint_length / division_distance);
    divisions = (int) Math.Max(2, Math.Min(20, divisions));
    divisions += divisions % 2;
    ////////////////////////////////////////////////////////////////////
    //Interpolate points
    ////////////////////////////////////////////////////////////////////
    Point3d[][] arrays = new Point3d[4][];
    for(int i = 0; i < 4; i++)
      arrays[i] = InterpolatePoints(rect_pair[0][i], rect_pair[1][i], divisions, false);

    ////////////////////////////////////////////////////////////////////
    //Move segments
    ////////////////////////////////////////////////////////////////////
    int start = 0;
    double t = 0.25;
    Vector3d v = t == 0 ? Vector3d.Zero : new Vector3d(0, 0, t / (divisions + 2));
    for(int i = start; i < 4; i++){

      int mid = (int) (arrays[i].Length * 0.5);

      for(int j = 0; j < arrays[i].Length; j++){
     
        int flip = (j < arrays[i].Length * 0.5) ? 1 : -1;

        if( i == 1 ){
          if( j < (mid - 1) || j > mid )
            arrays[i][j] -= 4*v * flip;
        }else if(i == 0 ||i == 2 ){
          if( j < (mid - 1) || j > mid )
            arrays[i][j] -= 2*v * flip;
        }
        
//        if(j < (mid - 1))
//          arrays[i][j] -= v * 3;
//        else if()

      }
    }

    ////////////////////////////////////////////////////////////////////
    //Create Polylines
    ////////////////////////////////////////////////////////////////////
    Polyline[] m_0 = new Polyline[2];
    Polyline[] m_1 = new Polyline[2];
    Polyline[] f_0 = new Polyline[2];
    Polyline[] f_1 = new Polyline[2];


    for(int i = 0; i < 4;i += 2){
      Polyline pline = new Polyline();
      for(int j = 0; j < arrays[0].Length; j++){

        bool flip = j % 2 < 1;
        flip = i < 2 ? flip : !flip;

        if(flip){
          pline.Add(arrays[i + 0][j]);
          pline.Add(arrays[i + 1][j]);
        } else{
          pline.Add(arrays[i + 1][j]);
          pline.Add(arrays[i + 0][j]);
        }

      }

      if(i < 2){
        m_1[0] = pline;
        m_1[1] = new Polyline(){pline[0],pline[pline.Count - 1]};
      }else{
        m_0[0] = pline;
        m_0[1] = new Polyline(){pline[0],pline[pline.Count - 1]};
      }
    }

    for(int i = 1; i < 4;i += 2){
      Polyline pline = new Polyline();
      for(int j = 0; j < arrays[0].Length; j++){

        bool flip = j % 2 == 0;
        flip = i < 2 ? flip : !flip;

        if(flip){
          pline.Add(arrays[i + 0][j]);
          pline.Add(arrays[(i + 1) % 4][j]);
        } else{
          pline.Add(arrays[(i + 1) % 4][j]);
          pline.Add(arrays[i + 0][j]);
        }

      }

      if(i < 2){
        f_0[0] = pline;
        f_0[1] = new Polyline(){pline[0],pline[pline.Count - 1]};
      }else{
        f_1[0] = pline;
        f_1[1] = new Polyline(){pline[0],pline[pline.Count - 1]};
      }
    }



    ////////////////////////////////////////////////////////////////////
    //Output
    ////////////////////////////////////////////////////////////////////

    var dt = new DataTree<Polyline>();
    dt.AddRange(m_0, new GH_Path(0));
    dt.AddRange(m_1, new GH_Path(0));
    dt.AddRange(f_0, new GH_Path(0));
    dt.AddRange(f_1, new GH_Path(0));
    A = dt;
    B = arrays;
    C = "ss_e_op_0_" + divisions.ToString();
# ---------- c_script_2: C# additional code ----------
  public  Point3d[] InterpolatePoints(Point3d from, Point3d to, int Steps, bool includeEnds = true) {
    Point3d[] point3DArray;

    if (includeEnds) {
      point3DArray = new Point3d[Steps + 2];
      point3DArray[0] = from;

      for (int i = 1; i < Steps + 1; i++) {
        double num = i / (double) (1 + Steps);

        point3DArray[i] = new Point3d(
          Lerp(from.X, to.X, num),
          Lerp(from.Y, to.Y, num),
          Lerp(from.Z, to.Z, num)
          );
      }

      point3DArray[point3DArray.Length - 1] = to;
    } else {

      point3DArray = new Point3d[Steps];

      for (int i = 1; i < Steps + 1; i++) {
        double num = i / (double) (1 + Steps);

        point3DArray[i - 1] = new Point3d(
          Lerp(from.X, to.X, num),
          Lerp(from.Y, to.Y, num),
          Lerp(from.Z, to.Z, num)
          );
      }
    }

    return point3DArray;


  }

  public double Lerp(double value1, double value2, double amount) {
    return value1 + (value2 - value1) * amount;
  }

  /// <summary>
  /// This method will be called once every solution, before any calls to RunScript.
  /// </summary>
  public override void BeforeRunScript()
  { }
  /// <summary>
  /// This method will be called once every solution, after any calls to RunScript.
  /// </summary>
  public override void AfterRunScript()
  { }
# ---------- end c_script_2 ----------
c_script_3 = CSharpScript(rect_pair=crv_2)  # -> out, A, B, C; inputs rect_pair: list of Polyline
# ---------- c_script_3: C# ----------
    ////////////////////////////////////////////////////////////////////
    //Number of divisions
    //Input joint line (its lengths)
    //Input distance for division
    ////////////////////////////////////////////////////////////////////
    double joint_length = Math.Abs(500);
    double division_distance = Math.Abs(60);
    int divisions = (int) Math.Ceiling(joint_length / division_distance);
    divisions = (int) Math.Max(2, Math.Min(20, divisions));
    divisions += divisions % 2;
    ////////////////////////////////////////////////////////////////////
    //Interpolate points
    ////////////////////////////////////////////////////////////////////
    Point3d[][] arrays = new Point3d[4][];
    for(int i = 0; i < 4; i++)
      arrays[i] = InterpolatePoints(rect_pair[0][i], rect_pair[1][i], divisions, false);

    ////////////////////////////////////////////////////////////////////
    //Move segments
    ////////////////////////////////////////////////////////////////////
    int start = 0;
    double t = 0.1;
    Vector3d v = t == 0 ? Vector3d.Zero : new Vector3d(0,0, t / (divisions + 2));
    for(int i = start; i < 4; i++){

      int mid = (int) (arrays[i].Length * 0.5);

      for(int j = 0; j < arrays[i].Length; j++){
        
        int flip = (j % 2 == 0) ? 1 : -1;
        flip = i < 2 ? flip : flip * -1;

        arrays[i][j] += v * flip;

      

      }
    }

    ////////////////////////////////////////////////////////////////////
    //Create Polylines
    ////////////////////////////////////////////////////////////////////
    Polyline[] m_0 = new Polyline[2];
    Polyline[] m_1 = new Polyline[2];
    Polyline[] f_0 = new Polyline[2];
    Polyline[] f_1 = new Polyline[2];


    for(int i = 0; i < 4;i += 2){
      Polyline pline = new Polyline();
      for(int j = 0; j < arrays[0].Length; j++){

        bool flip = j % 2 < 1;
        flip = i < 2 ? flip : !flip;

        if(flip){
          pline.Add(arrays[i + 0][j]);
          pline.Add(arrays[i + 1][j]);
        } else{
          pline.Add(arrays[i + 1][j]);
          pline.Add(arrays[i + 0][j]);
        }

      }

      if(i < 2){
        m_1[0] = pline;
        m_1[1] = new Polyline(){pline[0],pline[pline.Count - 1]};
      }else{
        m_0[0] = pline;
        m_0[1] = new Polyline(){pline[0],pline[pline.Count - 1]};
      }
    }

    for(int i = 1; i < 4;i += 2){
      Polyline pline = new Polyline();
      for(int j = 0; j < arrays[0].Length; j++){

        bool flip = j % 2 == 0;
        flip = i < 2 ? flip : !flip;

        if(flip){
          pline.Add(arrays[i + 0][j]);
          pline.Add(arrays[(i + 1) % 4][j]);
        } else{
          pline.Add(arrays[(i + 1) % 4][j]);
          pline.Add(arrays[i + 0][j]);
        }

      }

      if(i < 2){
        f_0[0] = pline;
        f_0[1] = new Polyline(){pline[0],pline[pline.Count - 1]};
      }else{
        f_1[0] = pline;
        f_1[1] = new Polyline(){pline[0],pline[pline.Count - 1]};
      }
    }



    ////////////////////////////////////////////////////////////////////
    //Output
    ////////////////////////////////////////////////////////////////////

    var dt = new DataTree<Polyline>();
    dt.AddRange(m_0, new GH_Path(0));
    dt.AddRange(m_1, new GH_Path(0));
    dt.AddRange(f_0, new GH_Path(0));
    dt.AddRange(f_1, new GH_Path(0));
    A = dt;
    B = arrays;
    C = "ss_e_op_0_" + divisions.ToString();
# ---------- c_script_3: C# additional code ----------
  public  Point3d[] InterpolatePoints(Point3d from, Point3d to, int Steps, bool includeEnds = true) {
    Point3d[] point3DArray;

    if (includeEnds) {
      point3DArray = new Point3d[Steps + 2];
      point3DArray[0] = from;

      for (int i = 1; i < Steps + 1; i++) {
        double num = i / (double) (1 + Steps);

        point3DArray[i] = new Point3d(
          Lerp(from.X, to.X, num),
          Lerp(from.Y, to.Y, num),
          Lerp(from.Z, to.Z, num)
          );
      }

      point3DArray[point3DArray.Length - 1] = to;
    } else {

      point3DArray = new Point3d[Steps];

      for (int i = 1; i < Steps + 1; i++) {
        double num = i / (double) (1 + Steps);

        point3DArray[i - 1] = new Point3d(
          Lerp(from.X, to.X, num),
          Lerp(from.Y, to.Y, num),
          Lerp(from.Z, to.Z, num)
          );
      }
    }

    return point3DArray;


  }

  public double Lerp(double value1, double value2, double amount) {
    return value1 + (value2 - value1) * amount;
  }

  /// <summary>
  /// This method will be called once every solution, before any calls to RunScript.
  /// </summary>
  public override void BeforeRunScript()
  { }
  /// <summary>
  /// This method will be called once every solution, after any calls to RunScript.
  /// </summary>
  public override void AfterRunScript()
  { }
# ---------- end c_script_3 ----------
crv_3 = Curve(c_script.Polylines)
clean = CleanTree(RemoveNulls=True, RemoveInvalid=True, RemoveEmpty=invert(False), Tree=c_script_2.A)
clean_2 = CleanTree(RemoveNulls=True, RemoveInvalid=True, RemoveEmpty=invert(False), Tree=c_script_3.A)
panel = Panel(c_script.Polylines)
gl_shader = GLShader(
    Vertex=[Point(-1, -1, -1), Point(1, -1, -1), Point(1, 1, -1), Point(-1, 1, -1)],
    Color=RGB(0, 0, 0),
    Thickness=Slider(5, range=0..10),
    Res=15,
    DepthTestingEnabled=False,
    DepthWritingEnabled=False,
    DrawMode=6,
    FragmentShader="""#version 330 core
uniform sampler2D _depthBuffer;
uniform sampler2D _colorBuffer;

uniform vec2 _viewportSize;
uniform vec4 color;
uniform float thickness;
uniform float res;

void main() 
{
  vec2 uv = gl_FragCoord.xy / _viewportSize;

  vec4 buffer = texture(_depthBuffer, uv);
  float val = step(0.9999, buffer.x);
  float col = 1.0;
  float div = res;
  float stepang = 360.0 / div;
  for(float i = 0; i<div; i++){
    vec4 bufferP = texture(_depthBuffer, (gl_FragCoord.xy + vec2(cos(radians(stepang*i)), sin(radians(stepang*i)))*thickness) / _viewportSize);
    float valP = step(0.9999, bufferP.x);
    if(val - valP > 0.0){
      col *= 0.0;
    }
  }
  
  vec3 col3 = mix(color.xyz, texture(_colorBuffer, uv).xyz, col);
  
  gl_FragColor = vec4(vec3(col3), 1.0);
 
}""",
    GLShader=(0, 1, 0),
    PreviewSortOrder=5,
    VertexShader="""#version 330

layout(location = 0) in vec3 vertex;



out vec3 normal;

void main() {
  gl_Position = vec4(vertex,1.0);
}""",
    glLineWidth=1,
    glPointSize=8)
item = ListItem(List=clean, Index=0, Wrap=True)  # -> Item, Item1, Item2, Item3, Item4, Item5, Item6, Item7
item_2 = ListItem(List=clean_2, Index=0, Wrap=True)  # -> Item, Item1, Item2, Item3, Item4, Item5, Item6, Item7
crv_4 = Curve([item.Item4, item.Item6])
crv_5 = Curve([item.Item, item.Item2])
crv_6 = Curve([item_2.Item4, item_2.Item6])
crv_7 = Curve([item_2.Item, item_2.Item2])
loft = Loft(Curves=crv_4, Options={Adjust=False, Closed=False, LoftEnds=0, LoftSimp=0, LoftType=0, Rebuild=10, Refit=0.01})
loft_2 = Loft(Curves=crv_5, Options={Adjust=False, Closed=False, LoftEnds=0, LoftSimp=0, LoftType=0, Rebuild=10, Refit=0.01})
loft_3 = Loft(Curves=crv_6, Options={Adjust=False, Closed=False, LoftEnds=0, LoftSimp=0, LoftType=0, Rebuild=10, Refit=0.01})
loft_4 = Loft(Curves=crv_7, Options={Adjust=False, Closed=False, LoftEnds=0, LoftSimp=0, LoftType=0, Rebuild=10, Refit=0.01})
